# Grasshopper definition GeoOpt_kmeans.gh (Grasshopper 1.0.7)
# plug-ins: Hops

# MaCAD21
# GeoOpt seminar
# David A. Leon and Dai Kandil
mesh = Mesh(<mesh referenced from the Rhino model>)

# ---- group: change this features
demesh = DeconstructMesh(Mesh=mesh)  # -> Vertices, Faces, Colours, Normals
item = ListItem(List=demesh.Vertices, Index=0, Wrap=True)  # -> Item, Item1, Item2, Item3
ln = Line(StartPoint=item.Item, EndPoint=item.Item3)
ln_2 = Line(StartPoint=item.Item1, EndPoint=item.Item2)
len = Length(Curve=ln_2)
len_2 = Length(Curve=ln)
llx = LineLine(Line1=ln, Line2=ln_2)  # -> ParamA, ParamB, PointA, PointB
angle = Angle(VectorA=ln, VectorB=ln_2)  # -> Angle, Reflex

# ----
# K-Means clustering
explodemesh = GhPythonScript(m=mesh)  # -> out, a; inputs m: Mesh
# ---------- explodemesh: Python ----------
import Rhino.Geometry as rg

ghenv.Component.Message = "explode mesh"

exploded = []

for i in range(m.Faces.Count):
    m_copy = m.Duplicate()
    face = m_copy.Faces.ExtractFaces([i])
    exploded.append(face)
    
a = exploded
# ---------- end explodemesh ----------

# ---- group: define features to cluster
area = Area(Geometry=explodemesh.a)  # -> Area, Centroid
medges = MeshEdges(Mesh=explodemesh.a)  # -> NakedEdges, InteriorEdges, NonManifoldEdges
join = JoinCurves(Curves=[medges.NakedEdges, medges.InteriorEdges], Preserve=False)
len_3 = Length(Curve=join)  # -> flatten(Length)

# ----
entwine = Entwine(Branch00=len_2, Branch01=len, Branch02=llx.ParamA, Branch03=llx.ParamB, Branch04=angle.Angle, FlattenInputs=True)
entwine_2 = Entwine(Branch00=len_3, Branch01=area.Area, FlattenInputs=True)
clean = CleanTree(RemoveNulls=True, RemoveInvalid=True, RemoveEmpty=True, Tree=entwine_2)
clean_2 = CleanTree(RemoveNulls=True, RemoveInvalid=True, RemoveEmpty=True, Tree=entwine)
python = GhPythonScript(x=clean)  # -> out, a; inputs x: tree
# ---------- python: Python ----------
import Rhino.Geometry as rg
import ghpythonlib.treehelpers as th

def transpose(l):
    return map(list, zip(*l))
    


vec = th.tree_to_list(x)
features = len(vec)
dimensions = len(vec[0])

tvec = transpose(vec)

str_vecs = []
for v in tvec:
    empty = "[" 
    for i in range(len(v)):
        empty += str(v[i])
        if i != len(v)-1: empty += ","
        
    empty += "]"
    str_vecs.append(empty)
a = str_vecs
# ---------- end python ----------
panel = Panel(python.a)
number_slider = Slider(2, range=0..10)
panel_2 = Panel("http://127.0.0.1:5000/kmeans")

# ---- group: KMEANS
hops = Hops(
    Vectors=python.a,
    NumberOfClusters=number_slider,
    CacheResultsInMemory=False,
    CacheSolveResults=False,
    RemoteDefinitionLocation="http://127.0.0.1:5000/kmeans",
    RemoteSolveVersion=(0, 1, 0),
    ShowInput_Enabled=False,
    ShowInput_Path=False,
    SynchronousSolve=True)

# ----
python_2 = GhPythonScript(items=explodemesh.a, C=hops, k=number_slider)  # -> out, a; inputs items: list, C: list of Int32, k: Int32
# ---------- python_2: Python ----------
import Rhino.Geometry as rg
import ghpythonlib.treehelpers as th

clusters = [[] for i in range(k)]

for i in range(len(items)):
    clusters[C[i]].append(items[i])

a = th.list_to_tree(clusters)
# ---------- end python_2 ----------
tstat = TreeStatistics(Tree=python_2.a)  # -> Paths, Length, Count
series = Series(Start=0, Step=1, Count=tstat.Count)
gradient = Gradient(
    LowerLimit=0,
    UpperLimit=tstat.Count,
    Parameter=series,
    stops=[0: RGB(243, 57, 0), 0.1: RGB(236, 27, 60), 0.2: RGB(210, 0, 118), 0.3: RGB(103, 0, 120), 0.4: RGB(39, 72, 161), 0.5: RGB(1, 192, 229), 0.6: RGB(18, 178, 90), 0.7: RGB(79, 186, 8), 0.8: RGB(220, 237, 32), 0.9: RGB(247, 159, 20), 1: RGB(243, 57, 0)])
preview = CustomPreview(Geometry=python_2.a, Material=graft(gradient))
